# Grasshopper definition assignment_02.ghx (Grasshopper 1.0.7)

python = GhPythonScript(angle1=Slider(0.78, range=0..3.14), angle2=Slider(1.83, range=0..3.14))  # -> out, a
# ---------- python: Python ----------
"""Assignment 02: Build your own robot model
"""
from compas.artists import Artist
from compas.datastructures import Mesh
from compas.geometry import Circle
from compas.geometry import Cylinder
from compas.geometry import Frame
from compas.geometry import Plane
from compas.geometry import Translation
from compas.robots import Configuration
from compas.robots import Joint
from compas.robots import RobotModel

# create cylinder in yz plane
radius, length = 0.3, 5
cylinder = Cylinder(Circle(Plane([0, 0, 0], [1, 0, 0]), radius), length)
cylinder.transform(Translation.from_vector([length / 2.0, 0, 0]))

# create robot model
model = RobotModel("robot", links=[], joints=[])

# link meshes (calling Mesh.from_shape effectively creates a copy of the shape)
mesh1 = Mesh.from_shape(cylinder)
mesh2 = Mesh.from_shape(cylinder)

# add links
link0 = model.add_link("world")
link1 = model.add_link("link1", visual_mesh=mesh1, visual_color=(0.2, 0.5, 0.6))
link2 = model.add_link("link2", visual_mesh=mesh2, visual_color=(0.5, 0.6, 0.2))

# add joints between the links
axis = (0, 0, 1)

origin = Frame.worldXY()
model.add_joint("joint1", Joint.CONTINUOUS, link0, link1, origin, axis)

origin = Frame((length, 0, 0), (1, 0, 0), (0, 1, 0))
model.add_joint("joint2", Joint.CONTINUOUS, link1, link2, origin, axis)

# Create a configuration object matching the number of joints in your model
configuration = Configuration([angle1, angle2], [Joint.CONTINUOUS, Joint.CONTINUOUS])
# Update the model using the artist
artist = Artist(model)
artist.update(configuration)

# Render everything
a = artist.draw_visual()
artist.redraw()
# ---------- end python ----------
